# Grasshopper definition Collaborative currency maker - Grasshopper file.gh (Grasshopper 0.9.76)
# plug-ins: LocalCode, Firefly.X, gHowl, setFlounderCamera, Weaverbird, Firefly.Core

send_pattern_osc = Panel("999")
port = Panel("8000")
netsource = NetworkSource()  # -> NetworkAdapterIsUp, AdapterProperties, LocalIpAddress
udp = UDPReceiver(Address=netsource.LocalIpAddress, Port=port, Pattern=send_pattern_osc)  # -> Info, Data
osc_d = OSCDispatch(OSCDevices=["/1/push1", "/1/push2", "/1/push3"], OSCMessage=udp.Data)  # -> OSCDevice, OSCData
message = Panel(udp.Data)
panel = Panel(osc_d.OSCData)
panel_2 = Panel(osc_d.OSCDevice)
item = ListItem(List=osc_d.OSCData, Index=Slider(2, range=0..10), Wrap=True)
item_2 = ListItem(List=osc_d.OSCData, Index=Slider(1, range=0..1), Wrap=True)
item_3 = ListItem(List=osc_d.OSCData, Index=Slider(0, range=0..100), Wrap=True)
panel_3 = Panel(item_3)
panel_4 = Panel(item)
panel_5 = Panel(item_2)
tones = ToneGenerator(AudioFrequency=Slider(360, range=0..1000), Volume=0.5, Duration=Slider(0.01, range=0..0.01), Repeat=panel_4)
tones_2 = ToneGenerator(AudioFrequency=Slider(784, range=0..1000), Volume=0.5, Duration=Slider(0.01, range=0..0.01), Repeat=panel_5)
tones_3 = ToneGenerator(AudioFrequency=Slider(1000, range=0..1000), Volume=0.5, Duration=Slider(0.01, range=0..0.01), Repeat=panel_3)
state_scan_coin_side1 = Panel(panel_3)
state_scan_coin_side2 = Panel(panel_5)
merge = Merge(Data1=state_scan_coin_side1, Data2=state_scan_coin_side2)
sort = SortList(Keys=merge)  # -> Keys, ValuesA
rev = ReverseList(List=sort.Keys)
video_stream = WebCamVideoStream()
ballnose_bit_diameter = Slider(3, range=0..10)
crop_margin_factor = Slider(0.05, range=0..0.45)
camera_resolution_y = Slider(240, range=0..1000)
camera_resolution_x = Slider(320, range=0..1000)
md_slider = MDSlider(
    slider_value=Point(0.9573170732, 0.3235950005, 0.5),
    SliderMode=0,
    x_domain=Domain(-1, 1),
    y_domain=Domain(-1, 1),
    z_domain=Domain(0, 1))
coin_diameter = Slider(8, range=0..100)
item_4 = ListItem(List=rev, Index=0, Wrap=True)
coin_diameter_2 = Slider(60, range=0..100)
number_slider = Slider(233.3, range=200..250)
number_slider_2 = Slider(0, range=0..1000)
number_slider_3 = Slider(463.5, range=400..500)
number_slider_4 = Slider(625, range=0..1000)
max_z_depth = Slider(2, range=0.1..10)
button = Button()
invert_heighmap = BooleanToggle(True)
pdecon = Deconstruct(Point=md_slider)  # -> XComponent, YComponent, ZComponent
spiral_toolpath_guide_curve = Curve(<curve referenced from the Rhino model>)
toolpath_resolution = Panel(Slider(0.2, range=0.01..0.5))
coin_edge_geometry = Mesh(<mesh referenced from the Rhino model>)
panel_6 = Panel(item_4)
ballnose_bit_diameter_2 = Panel(ballnose_bit_diameter)
max_z_depth_2 = Panel(max_z_depth)
coin_thickness = Panel(coin_diameter)
coin_diameter_3 = Panel(coin_diameter_2)
invert_heighmap_2 = Panel(invert_heighmap)
camera_resolution_y_2 = Panel(camera_resolution_y)
camera_resolution_x_2 = Panel(camera_resolution_x)
crop_margin_factor_2 = Panel(crop_margin_factor)
pt = ConstructPoint(XCoordinate=number_slider, YCoordinate=number_slider_3, ZCoordinate=Slider(1040, range=1000..1100))
pt_2 = ConstructPoint(XCoordinate=number_slider, YCoordinate=number_slider_3, ZCoordinate=Slider(0, range=0..1000))
blink = BinaryBlink(BlinkPattern=500, Start=Toggle(True), Repeat=True)
multiplication = Multiplication(A=pdecon.XComponent, B=Slider(4, range=0..10))
filter = StreamFilter(Gate=panel_6, Stream1="now")
rad = Radians(Degrees=Slider(0.357, range=0..1))
postion_correction_crop_x = Panel(multiplication)
X = UnitX(Factor=1)
panel_7 = Panel(blink)
Z = UnitZ(Factor=1)
postion_correction_crop_y = Panel(pdecon.YComponent)
time = Time(filter)
vrot = Rotate(Vector=X, Axis=Z, Angle=rad)
int = Integer(Slider(50, range=0..100))
rec = DataRecorder(time, DataLimit=1, RecordData=True)
division = Division(A=coin_diameter_3, B=Slider(2, range=0..10))
multiplication_2 = Multiplication(A=camera_resolution_y_2, B=crop_margin_factor_2)
multiplication_3 = Multiplication(A=camera_resolution_y_2, B=crop_margin_factor_2)
syncfloundercamera = SyncFlounderCamera(Activate=Toggle(True), ViewportName="DyvikDesign", Location=pt, Target=pt_2, Lens=int, Up=vrot)
panel_8 = Panel(rec)
neg = Negative(Value=division)
multiplication_4 = Multiplication(A=multiplication_3, B=postion_correction_crop_y)
multiplication_5 = Multiplication(A=multiplication_2, B=postion_correction_crop_x)
saturation = BrightnessAndSaturation(
    BitmapToModify=video_stream,
    SaturationMultiplier=Slider(0, range=0..100),
    BrightnessMultiplier=Slider(0.734, range=0..2))
dom = ConstructDomain(DomainStart=neg, DomainEnd=division)
multiplication_6 = Multiplication(A=multiplication_2, B=Slider(2, range=0..10))
rep = ReplaceText(Text=panel_8, Find=",", RecursiveReplace=False)
contrast = Contrast(BitmapToModify=saturation, ContrastMultiplier=Slider(0.756, range=0..1))
subtraction = Subtraction(A=camera_resolution_y_2, B=multiplication_6)
rep_2 = ReplaceText(Text=rep, Find=":", Replace="-", RecursiveReplace=False)
int_2 = Integer(subtraction)
rep_3 = ReplaceText(Text=rep_2, Find=":", Replace="-", RecursiveReplace=False)
image_read_size = Panel(int_2)
rep_4 = ReplaceText(Text=rep_3, Find="(", RecursiveReplace=False)
rep_5 = ReplaceText(Text=rep_4, Find=")", RecursiveReplace=False)
panel_9 = Panel(image_read_size)
dam = DataDam(DataA=panel_6, BufferDelay=5000000, BufferMode=2)
panel_10 = Panel(rep_5)
addition = Addition(A=multiplication_2, B=multiplication_5)
addition_2 = Addition(A=multiplication_3, B=multiplication_4)
panel_11 = Panel(panel_10)
panel_12 = Panel("C:\Users\Jens\Documents\CompanyInfo\Workshops\Collaborative day\Bottle opener\Bitmaps\")
addition_3 = Addition(A=addition, B=image_read_size)
addition_4 = Addition(A=addition_2, B=image_read_size)
division_2 = Division(A=addition_2, B=camera_resolution_y_2)
division_3 = Division(A=addition_3, B=camera_resolution_x_2)
division_4 = Division(A=addition, B=camera_resolution_x_2)
division_5 = Division(A=addition_4, B=camera_resolution_y_2)
merge_2 = Merge(Data1=panel_12, Data2=panel_10, Data3="_0", Data4=".png")
sequence = SnapshotSequence(
    BitmapToModify=contrast,
    NumberOfSnapshotsToRecord=1,
    TimeIntervalMillisecondsBetweenRecordings=1000,
    FileDirectory=panel_12,
    FileName=panel_11,
    ImageType=2,
    Start=dam)
pt_3 = ConstructPoint(XCoordinate=division_4, YCoordinate=division_2, ZCoordinate=0)
pt_4 = ConstructPoint(XCoordinate=division_3, YCoordinate=division_5, ZCoordinate=0)
join = TextJoin(Text=flatten(merge_2))
panel_13 = Panel(join)
dam_2 = DataDam(DataA=panel_13, BufferDelay=20000000, BufferMode=2)
load_bitmap = LoadBitmap(FilePathToImageLocation=dam_2)
painter = BitmapPainter(BitmapToPaint=load_bitmap)
region = ImageRegion(BitmapToModify=load_bitmap, MinimumPointOfBoundingArea=pt_3, MaximumPointOfBoundingArea=pt_4)
painter_2 = BitmapPainter(BitmapToPaint=region)
invert = Invert(BitmapToModify=region)
surface_start_depth = Panel("0.2")
number_slider_5 = Slider(2.3, range=0..10)
division_6 = Division(A=max_z_depth_2, B=number_slider_5)
domain = Domain(dom)
addition_5 = Addition(A=number_slider_5, B=surface_start_depth)
neg_2 = Negative(Value=addition_5)
mesh = MeshFromImage(Bmp=invert, Sx=domain, Sy=domain, Z=division_6, C=True)
Z_2 = UnitZ(Factor=neg_2)
demesh = DeconstructMesh(Mesh=mesh)  # -> Vertices, Faces, Colours, Normals
division_7 = Division(A=ballnose_bit_diameter_2, B=Slider(2, range=0..10))
conmesh = ConstructMesh(Vertices=demesh.Vertices, Faces=demesh.Faces)
Z_3 = UnitZ(Factor=ballnose_bit_diameter_2)
move = Move(Geometry=spiral_toolpath_guide_curve, Motion=Z_3)  # -> Geometry, Transform
move_2 = Move(Geometry=conmesh, Motion=Z_2)  # -> Geometry, Transform
coin_edge_geometry_2 = Mesh(coin_edge_geometry)
divide_curve_even_lenght = DivideCurveEvenLenght(crv=move.Geometry, B=Slider(0.6, range=0..1))
wblaplace = WeaverbirdsLaplacianSmoothing(MeshCurves=move_2.Geometry, Level=Slider(2, range=0..10), SmoothNakedEdges=1, Thin=1)
topoly = CurveToPolyline(Curve=move.Geometry, ToleranceDistance=toolpath_resolution, ToleranceAngle=0)  # -> Polyline, Segments; disabled
wboffset = WeaverbirdsOffsetMesh(MeshCurves=coin_edge_geometry_2, Distance=division_7, OffsetType=0)
wboffset_2 = WeaverbirdsOffsetMesh(MeshCurves=wblaplace, Distance=division_7, OffsetType=0)

# ---- group: Detect coin side scan
filter_2 = StreamFilter(Gate=state_scan_coin_side1, Stream1=Slider(1, range=0..1))
filter_3 = StreamFilter(Gate=state_scan_coin_side2, Stream1=Slider(2, range=0..10))
flatten = FlattenTree(Tree=[filter_2, filter_3], Path="{0}")
rec_2 = DataRecorder(flatten, DataLimit=1, RecordData=True)
panel_14 = Panel(rec_2)

# ----
cp = ControlPoints(Curve=topoly.Polyline)  # -> Points, Weights, Knots; disabled
mjoin = MeshJoin(Meshes=flatten([wboffset_2, wboffset]))
neg_3 = Negative(Value=division_7)
Z_4 = UnitZ(Factor=neg_3)
move_3 = Move(Geometry=mjoin, Motion=Z_4)  # -> Geometry, Transform

# ---- group: Make 3D coin for STL export
coin_thickness_2 = Panel(coin_diameter)
gate = StreamGate(Stream=flatten(wblaplace), Gate=flatten(panel_14))  # -> Target0, Target1, Target2
division_8 = Division(A=coin_thickness_2, B=Slider(2, range=0..10))
neg_4 = Negative(Value=division_8)
dam_3 = DataDam(DataA=gate.Target1, BufferDelay=20000000, BufferMode=2)
dam_4 = DataDam(DataA=gate.Target2, BufferDelay=20000000, BufferMode=2)
pt_5 = ConstructPoint(XCoordinate=0, YCoordinate=0, ZCoordinate=neg_4)
dam_5 = DataDam(DataA=dam_3, BufferDelay=20000000, BufferMode=2)
dam_6 = DataDam(DataA=dam_4, BufferDelay=20000000, BufferMode=2)
dam_7 = DataDam(DataA=dam_5, BufferDelay=20000000, BufferMode=2)
dam_8 = DataDam(DataA=dam_6, BufferDelay=20000000, BufferMode=2)
xz = XZPlane(Origin=pt_5)
yz = YZPlane(Origin=pt_5)
rec_3 = DataRecorder(dam_8, DataLimit=1, RecordData=True)
rec_4 = DataRecorder(dam_7, DataLimit=1, RecordData=True)
rotate = Rotate(Geometry=rec_3, Angle=degrees(Slider(180, range=0..1000)), Plane=xz)  # -> Geometry, Transform
mesh_for_coin_split_top = Mesh(<mesh referenced from the Rhino model>)
mesh_for_coin_split_bot = Mesh(<mesh referenced from the Rhino model>)
mesh_2 = Mesh(rec_4)
mesh_3 = Mesh(rotate.Geometry)
msplit = MeshSplit(Mesh=mesh_3, Splitters=mesh_for_coin_split_bot)
msplit_2 = MeshSplit(Mesh=mesh_2, Splitters=mesh_for_coin_split_top)
mesh_for_coin_join = Mesh(<mesh referenced from the Rhino model>)
item_5 = ListItem(List=msplit_2, Index=0, Wrap=True)
item_6 = ListItem(List=msplit, Index=0, Wrap=True)
mjoin_2 = MeshJoin(Meshes=flatten([mesh_for_coin_join, item_5, item_6]))
rotate_2 = Rotate(Geometry=mjoin_2, Angle=degrees(Slider(270, range=0..1000)), Plane=yz)  # -> Geometry, Transform

# ---- group: Make 3D toolpaths for CNC milling
Z_5 = UnitZ(Factor=1)
rev_2 = Reverse(Vector=Z_5)
meshray = MeshRay(Mesh=move_3.Geometry, Point=divide_curve_even_lenght, Direction=rev_2)  # -> Point, Hit
pline = PolyLine(Vertices=meshray.Point, Closed=False)
gate_2 = StreamGate(Stream=flatten(pline), Gate=flatten(panel_14))  # -> Target0, Target1, Target2
position_outline_coin2 = Curve(<curve referenced from the Rhino model>)
position_outline_coin1 = Curve(<curve referenced from the Rhino model>)
rec_5 = DataRecorder(gate_2.Target1, DataLimit=1, RecordData=True)
rec_6 = DataRecorder(gate_2.Target2, DataLimit=1, RecordData=True)
toolpath_coins_side1 = Curve(rec_5)
toolpath_coins_side2 = Curve(rec_6)
area = Area(Geometry=position_outline_coin1)  # -> Area, Centroid
area_2 = Area(Geometry=position_outline_coin2)  # -> Area, Centroid
pdecon_2 = Deconstruct(Point=area.Centroid)  # -> XComponent, YComponent, ZComponent
pdecon_3 = Deconstruct(Point=area_2.Centroid)  # -> XComponent, YComponent, ZComponent
X_2 = UnitX(Factor=Slider(70, range=0..100))
pt_6 = ConstructPoint(XCoordinate=pdecon_2.XComponent, YCoordinate=pdecon_2.YComponent, ZCoordinate=0)
pt_7 = ConstructPoint(XCoordinate=pdecon_3.XComponent, YCoordinate=pdecon_3.YComponent, ZCoordinate=0)
move_4 = Move(Geometry=toolpath_coins_side2, Motion=X_2)  # -> Geometry, Transform
neg_5 = Negative(Value=Slider(90, range=0..100))
xy = XYPlane(Origin=pt_6)
neg_6 = Negative(Value=Slider(90, range=0..100))
xy_2 = XYPlane(Origin=pt_7)
rotate_3 = Rotate(Geometry=xy, Angle=degrees(neg_5), Plane=xy)  # -> Geometry, Transform
rotate_4 = Rotate(Geometry=xy_2, Angle=degrees(neg_6), Plane=xy_2)  # -> Geometry, Transform
xy_3 = XYPlane(Origin=Point(0, 0, 0))
pln = Plane(rotate_3.Geometry)
pln_2 = Plane(rotate_4.Geometry)
rotate_5 = Rotate(Geometry=xy_3, Angle=degrees(Slider(180, range=0..1000)), Plane=xy_3)  # -> Geometry, Transform
orient = Orient(Geometry=toolpath_coins_side1, Source=rotate_5.Geometry, Target=[pln, pln_2])  # -> Geometry, Transform
orient_2 = Orient(Geometry=toolpath_coins_side2, Source=rotate_5.Geometry, Target=[pln, pln_2])  # -> Geometry, Transform

# ---- group: Coin 3D preview
number_slider_6 = Slider(100, range=0..1000)
Y = UnitY(Factor=number_slider_6)
X_3 = UnitX(Factor=number_slider_6)
rev_3 = Reverse(Vector=Y)
move_5 = Move(Geometry=pln, Motion=X_3)  # -> Geometry, Transform
move_6 = Move(Geometry=pln_2, Motion=X_3)  # -> Geometry, Transform
number_slider_7 = Slider(45, range=0..100)
move_7 = Move(Geometry=move_5.Geometry, Motion=Y)  # -> Geometry, Transform
move_8 = Move(Geometry=move_6.Geometry, Motion=rev_3)  # -> Geometry, Transform
deplane = DeconstructPlane(Plane=move_7.Geometry)  # -> Origin, XAxis, YAxis, ZAxis
deplane_2 = DeconstructPlane(Plane=move_8.Geometry)  # -> Origin, XAxis, YAxis, ZAxis
neg_7 = Negative(Value=number_slider_7)
Z_6 = UnitZ(Factor=1)
Z_7 = UnitZ(Factor=1)
pl = ConstructPlane(Origin=deplane.Origin, XAxis=deplane.XAxis, YAxis=Z_6)
pl_2 = ConstructPlane(Origin=deplane_2.Origin, XAxis=deplane_2.XAxis, YAxis=Z_7)
xy_4 = XYPlane(Origin=pt_5)
scale = Scale(Geometry=mjoin_2, Center=pt_5, Factor=Slider(2, range=0..10))  # -> Geometry, Transform
rotate_6 = Rotate(Geometry=move_8.Geometry, Angle=degrees(number_slider_7), Plane=pl_2)  # -> Geometry, Transform
rotate_7 = Rotate(Geometry=move_7.Geometry, Angle=degrees(neg_7), Plane=pl)  # -> Geometry, Transform
deplane_3 = DeconstructPlane(Plane=rotate_6.Geometry)  # -> Origin, XAxis, YAxis, ZAxis
rev_4 = Reverse(Vector=deplane_3.XAxis)
pl_3 = ConstructPlane(Origin=deplane_3.Origin, XAxis=rev_4, YAxis=deplane_3.YAxis)
rotate_8 = Rotate(Geometry=xy_4, Angle=degrees(Slider(180, range=0..1000)), Plane=xy_4)  # -> Geometry, Transform
orient_3 = Orient(Geometry=scale.Geometry, Source=rotate_8.Geometry, Target=pl_3)  # -> Geometry, Transform
orient_4 = Orient(Geometry=scale.Geometry, Source=rotate_8.Geometry, Target=rotate_7.Geometry)  # -> Geometry, Transform

# ----
toolpath_coin_side2_positioned = Curve(flatten(orient_2.Geometry))
state_save_stl_button = Panel(panel_4)
toolpath_coin_side1_positioned = Curve(flatten(orient.Geometry))
panel_15 = Panel(panel_11)
flatten_2 = FlattenTree(Tree=state_save_stl_button, Path="{0}")
dam_9 = DataDam(DataA=toolpath_coin_side1_positioned, BufferDelay=10000000, BufferMode=2)
dam_10 = DataDam(DataA=toolpath_coin_side2_positioned, BufferDelay=20000000, BufferMode=2)
join_2 = TextJoin(Text=["C:\Users\Public\Collaborative Currency STLs\", panel_15, ".stl"])
localcodeexport = LocalCodeExport(DestinationFilePath=join_2, Export=flatten_2, LayerNames="ExportLayer", GeometryTree=rotate_2.Geometry)
panel_16 = Panel(localcodeexport)
spindle_speed = Slider(18000, range=0..100000)
safe_z = Slider(6, range=0..20)
plunge_rate = Slider(35, range=0..100)
resample_tolerance = Slider(0.02, range=0.02..0.1)
feed_rate = Slider(55, range=0..100)
custom_jog_home_y = Slider(780, range=0..1000)
custom_jog_home_x = Slider(430, range=0..1000)
resample_curve = BooleanToggle(False)
use_spindle = BooleanToggle(True)
use_custom_jog_home = BooleanToggle(True)
toolpath_coin_side1_positioned_2 = Curve(flatten(dam_9))
toolpath_coin_side2_positioned_2 = Curve(flatten(dam_10))
toolpaths = Curve(toolpath_coin_side1_positioned_2)
toolpaths_2 = Curve(toolpath_coin_side2_positioned_2)
feed_rate_2 = Number(feed_rate)
plunge_rate_2 = Number(plunge_rate)
safe_z_height = Number(safe_z)
resample_curve_2 = Integer(resample_curve)
sample_tolerance_in_mm = Number(resample_tolerance)
spindle_speed_2 = Number(spindle_speed)
use_custom_jog_home_2 = Integer(use_custom_jog_home)
temp_home_x = Number(custom_jog_home_x)
temp_home_y = Number(custom_jog_home_y)
spindle_use_bollean = Number(use_spindle)
plunge_rate_3 = Number(plunge_rate)
safe_z_height_2 = Number(safe_z)
sample_tolerance_in_mm_2 = Number(resample_tolerance)
spindle_speed_3 = Number(spindle_speed)
use_custom_jog_home_3 = Integer(use_custom_jog_home)
temp_home_y_2 = Number(custom_jog_home_y)
feed_rate_3 = Number(feed_rate)
resample_curve_3 = Integer(resample_curve)
spindle_use_bollean_2 = Number(use_spindle)
temp_home_x_2 = Number(custom_jog_home_x)
topoly_2 = CurveToPolyline(Curve=toolpaths, ToleranceDistance=sample_tolerance_in_mm, ToleranceAngle=0)  # -> Polyline, Segments
filter_4 = StreamFilter(Gate=resample_curve_2, Stream0=toolpaths, Stream1=topoly_2.Polyline)
topoly_3 = CurveToPolyline(Curve=toolpaths_2, ToleranceDistance=sample_tolerance_in_mm_2, ToleranceAngle=0)  # -> Polyline, Segments
filter_5 = StreamFilter(Gate=resample_curve_3, Stream0=toolpaths_2, Stream1=topoly_3.Polyline)
cp_2 = ControlPoints(Curve=filter_4)  # -> Points, Weights, Knots
cp_3 = ControlPoints(Curve=filter_5)  # -> Points, Weights, Knots
toolpath_points = Point(cp_2.Points)
toolpath_points_2 = Point(cp_3.Points)
rev_5 = ReverseList(List=cp_2.Points)
pdecon_4 = Deconstruct(Point=toolpath_points)  # -> XComponent, YComponent, ZComponent
lng = ListLength(List=toolpath_points)
safe_z_height_3 = Number(safe_z_height)
item_7 = ListItem(List=cp_2.Points, Index=0, Wrap=True)
rev_6 = ReverseList(List=cp_3.Points)
item_8 = ListItem(List=rev_5, Index=0, Wrap=True)
pdecon_5 = Deconstruct(Point=toolpath_points_2)  # -> XComponent, YComponent, ZComponent
lng_2 = ListLength(List=toolpath_points_2)
safe_z_height_4 = Number(safe_z_height_2)
item_9 = ListItem(List=cp_3.Points, Index=0, Wrap=True)
pdecon_6 = Deconstruct(Point=item_7)  # -> XComponent, YComponent, ZComponent
item_10 = ListItem(List=rev_6, Index=0, Wrap=True)
flatten_3 = FlattenTree(Tree=lng, Path="{0}")
pdecon_7 = Deconstruct(Point=item_8)  # -> XComponent, YComponent, ZComponent
pdecon_8 = Deconstruct(Point=item_9)  # -> XComponent, YComponent, ZComponent
flatten_4 = FlattenTree(Tree=lng_2, Path="{0}")
pt_8 = ConstructPoint(XCoordinate=pdecon_6.XComponent, YCoordinate=pdecon_6.YComponent, ZCoordinate=safe_z_height_3)
pdecon_9 = Deconstruct(Point=item_10)  # -> XComponent, YComponent, ZComponent
panel_17 = Panel(pdecon_4.XComponent)
panel_18 = Panel(pdecon_4.YComponent)
panel_19 = Panel(pdecon_4.ZComponent)
merge_3 = Merge(Data1=Slider(0, range=0..100), Data2=flatten_3)
pt_9 = ConstructPoint(XCoordinate=pdecon_7.XComponent, YCoordinate=pdecon_7.YComponent, ZCoordinate=safe_z_height_3)
pt_10 = ConstructPoint(XCoordinate=pdecon_8.XComponent, YCoordinate=pdecon_8.YComponent, ZCoordinate=safe_z_height_4)
panel_20 = Panel(pdecon_5.XComponent)
panel_21 = Panel(pdecon_5.YComponent)
panel_22 = Panel(pdecon_5.ZComponent)
merge_4 = Merge(Data1=Slider(0, range=0..100), Data2=flatten_4)
pt_11 = ConstructPoint(XCoordinate=pdecon_9.XComponent, YCoordinate=pdecon_9.YComponent, ZCoordinate=safe_z_height_4)
safe_z_end_point = Point(pt_9)
safe_z_start_point = Point(pt_8)
toolpath_points_3 = Point(flatten(cp_2.Points))  # disabled
safe_z_end_point_2 = Point(pt_11)
safe_z_start_point_2 = Point(pt_10)
toolpath_points_4 = Point(flatten(cp_3.Points))  # disabled

# ---- group: Name
panel_23 = Panel("'coin side 1")

# ---- group: Set spindle speed
spindle_speed_4 = Number(spindle_speed_2)
int_3 = Integer(spindle_speed_4)
join_3 = TextJoin(Text=["TR,", int_3, ",1"])

# ---- group: Jog to safe Z
safe_z_height_5 = Number(flatten(safe_z_height_3))
text = Text("JZ,")
graft = GraftTree(Tree=safe_z_height_5, IncludeEmptyLists=True, IncludeNullItems=True)
graft_2 = GraftTree(Tree=text, IncludeEmptyLists=True, IncludeNullItems=True)
lng_3 = ListLength(List=flatten(merge_3))
join_4 = TextJoin(Text=[graft_2, graft])
dup = DuplicateData(Data=join_4, Number=lng_3, Order=True)

# ---- group: Turn off spindle
filter_6 = StreamFilter(Gate=spindle_use_bollean, Stream1="SO,1,0")

# ----
rev_7 = ReverseList(List=flatten(safe_z_end_point))

# ---- group: Toolpath coordinates
text_2 = Text("M3,")
text_3 = Text(",")
text_4 = Text(",")
dup_2 = DuplicateData(Data=text_4, Number=lng, Order=True)
dup_3 = DuplicateData(Data=text_3, Number=lng, Order=True)
dup_4 = DuplicateData(Data=text_2, Number=lng, Order=True)
simplify = SimplifyTree(Tree=flatten(dup_4), Front=False)
simplify_2 = SimplifyTree(Tree=flatten(panel_17), Front=False)
simplify_3 = SimplifyTree(Tree=flatten(dup_3), Front=False)
simplify_4 = SimplifyTree(Tree=flatten(panel_18), Front=False)
simplify_5 = SimplifyTree(Tree=flatten(dup_2), Front=False)
simplify_6 = SimplifyTree(Tree=flatten(panel_19), Front=False)
graft_3 = GraftTree(Tree=simplify, IncludeEmptyLists=True, IncludeNullItems=True)
graft_4 = GraftTree(Tree=simplify_2, IncludeEmptyLists=True, IncludeNullItems=True)
graft_5 = GraftTree(Tree=simplify_3, IncludeEmptyLists=True, IncludeNullItems=True)
graft_6 = GraftTree(Tree=simplify_4, IncludeEmptyLists=True, IncludeNullItems=True)
graft_7 = GraftTree(Tree=simplify_5, IncludeEmptyLists=True, IncludeNullItems=True)
graft_8 = GraftTree(Tree=simplify_6, IncludeEmptyLists=True, IncludeNullItems=True)
join_5 = TextJoin(Text=[graft_3, graft_4, graft_5, graft_6, graft_7, graft_8])
flatten_5 = FlattenTree(Tree=join_5, Path="{0}")

# ---- group: Start spindle
filter_7 = StreamFilter(Gate=spindle_use_bollean, Stream1="SO,1,1")
filter_8 = StreamFilter(Gate=spindle_use_bollean, Stream1="PAUSE 1")

# ----
lng_4 = ListLength(List=toolpath_points_3)
route_previvew_position = Number(Slider(0.452, range=0..1))

# ---- group: Name
panel_24 = Panel("'coin side 2")

# ---- group: Set spindle speed
spindle_speed_5 = Number(spindle_speed_3)
int_4 = Integer(spindle_speed_5)
join_6 = TextJoin(Text=["TR,", int_4, ",1"])

# ---- group: Jog to safe Z
safe_z_height_6 = Number(flatten(safe_z_height_4))
text_5 = Text("JZ,")
graft_9 = GraftTree(Tree=safe_z_height_6, IncludeEmptyLists=True, IncludeNullItems=True)
graft_10 = GraftTree(Tree=text_5, IncludeEmptyLists=True, IncludeNullItems=True)
lng_5 = ListLength(List=flatten(merge_4))
join_7 = TextJoin(Text=[graft_10, graft_9])
dup_5 = DuplicateData(Data=join_7, Number=lng_5, Order=True)

# ---- group: Turn off spindle
filter_9 = StreamFilter(Gate=spindle_use_bollean_2, Stream1="SO,1,0")

# ---- group: Set Feed rate (X Y speed) and plunge rate (Z speed)
feed_rate_4 = Number(feed_rate_2)
plunge_rate_4 = Number(plunge_rate_2)
plunge_rate_5 = Number(plunge_rate_4)
feed_rate_5 = Number(feed_rate_4)
text_6 = Text("MS,")
text_7 = Text(",")
join_8 = TextJoin(Text=[text_6, feed_rate_5, text_7, plunge_rate_5])

# ----
rev_8 = ReverseList(List=flatten(safe_z_end_point_2))

# ---- group: Toolpath coordinates
text_8 = Text("M3,")
text_9 = Text(",")
text_10 = Text(",")
dup_6 = DuplicateData(Data=text_10, Number=lng_2, Order=True)
dup_7 = DuplicateData(Data=text_9, Number=lng_2, Order=True)
dup_8 = DuplicateData(Data=text_8, Number=lng_2, Order=True)
simplify_7 = SimplifyTree(Tree=flatten(dup_8), Front=False)
simplify_8 = SimplifyTree(Tree=flatten(panel_20), Front=False)
simplify_9 = SimplifyTree(Tree=flatten(dup_7), Front=False)
simplify_10 = SimplifyTree(Tree=flatten(panel_21), Front=False)
simplify_11 = SimplifyTree(Tree=flatten(dup_6), Front=False)
simplify_12 = SimplifyTree(Tree=flatten(panel_22), Front=False)
graft_11 = GraftTree(Tree=simplify_7, IncludeEmptyLists=True, IncludeNullItems=True)
graft_12 = GraftTree(Tree=simplify_8, IncludeEmptyLists=True, IncludeNullItems=True)
graft_13 = GraftTree(Tree=simplify_9, IncludeEmptyLists=True, IncludeNullItems=True)
graft_14 = GraftTree(Tree=simplify_10, IncludeEmptyLists=True, IncludeNullItems=True)
graft_15 = GraftTree(Tree=simplify_11, IncludeEmptyLists=True, IncludeNullItems=True)
graft_16 = GraftTree(Tree=simplify_12, IncludeEmptyLists=True, IncludeNullItems=True)
join_9 = TextJoin(Text=[graft_11, graft_12, graft_13, graft_14, graft_15, graft_16])
flatten_6 = FlattenTree(Tree=join_9, Path="{0}")

# ---- group: Start spindle
filter_10 = StreamFilter(Gate=spindle_use_bollean_2, Stream1="SO,1,1")
filter_11 = StreamFilter(Gate=spindle_use_bollean_2, Stream1="PAUSE 1")

# ----
lng_6 = ListLength(List=toolpath_points_4)
cull_i = CullIndex(List=flatten(safe_z_start_point), Indices=0, Wrap=True)
cull_i_2 = CullIndex(List=rev_7, Indices=0, Wrap=True)
route_previvew_position_2 = Number(Slider(0.452, range=0..1))

# ---- group: Set Feed rate (X Y speed) and plunge rate (Z speed)
feed_rate_6 = Number(feed_rate_3)
plunge_rate_6 = Number(plunge_rate_3)
plunge_rate_7 = Number(plunge_rate_6)
feed_rate_7 = Number(feed_rate_6)
text_11 = Text("MS,")
text_12 = Text(",")
join_10 = TextJoin(Text=[text_11, feed_rate_7, text_12, plunge_rate_7])

# ----
number_slider_8 = Slider(3, range=0..10)
cull_i_3 = CullIndex(List=flatten(safe_z_start_point_2), Indices=0, Wrap=True)
cull_i_4 = CullIndex(List=rev_8, Indices=0, Wrap=True)
rev_9 = ReverseList(List=flatten(cull_i_2))
multiplication_7 = Multiplication(A=lng_4, B=route_previvew_position)
number_slider_9 = Slider(3, range=0..10)
rev_10 = ReverseList(List=flatten(cull_i_4))
multiplication_8 = Multiplication(A=lng_6, B=route_previvew_position_2)
ln = Line(StartPoint=safe_z_start_point, EndPoint=item_7)
item_11 = ListItem(List=toolpath_points_3, Index=multiplication_7, Wrap=True)
ln_2 = Line(StartPoint=rev_9, EndPoint=cull_i)
ln_3 = Line(StartPoint=item_8, EndPoint=safe_z_end_point)
ln_4 = Line(StartPoint=safe_z_start_point_2, EndPoint=item_9)
item_12 = ListItem(List=toolpath_points_4, Index=multiplication_8, Wrap=True)
ln_5 = Line(StartPoint=rev_10, EndPoint=cull_i_3)
ln_6 = Line(StartPoint=item_10, EndPoint=safe_z_end_point_2)
toolpath_preview_line = Curve(filter_4)  # disabled
cut_transition_preview_line = Curve(ln_2)
sph = Sphere(Base=item_11, Radius=Slider(1.5, range=0..10))
cut_entry_preview_line = Curve(ln)
filter_12 = StreamFilter(Gate=spindle_use_bollean, Stream1=join_3)
cut_exit_preview_line = Curve(ln_3)
toolpath_preview_line_2 = Curve(filter_5)  # disabled
material = CreateMaterial(
    Diffuse=ColourSwatch(SwatchColor=RGB(130, 249, 255)),
    Specular=RGB(255, 255, 255),
    Emission=RGB(0, 0, 0),
    Transparency=0,
    Shine=0)
material_2 = CreateMaterial(
    Diffuse=ColourSwatch(SwatchColor=RGB(99, 74, 16)),
    Specular=RGB(255, 255, 255),
    Emission=RGB(0, 0, 0),
    Transparency=0,
    Shine=0)
material_3 = CreateMaterial(
    Diffuse=ColourSwatch(SwatchColor=RGB(174, 234, 235)),
    Specular=RGB(255, 255, 255),
    Emission=RGB(0, 0, 0),
    Transparency=0,
    Shine=0)
material_4 = CreateMaterial(
    Diffuse=ColourSwatch(SwatchColor=RGB(77, 114, 115)),
    Specular=RGB(255, 255, 255),
    Emission=RGB(0, 0, 0),
    Transparency=0,
    Shine=0)
cut_transition_preview_line_2 = Curve(ln_5)
sph_2 = Sphere(Base=item_12, Radius=Slider(1.5, range=0..10))
cut_entry_preview_line_2 = Curve(ln_4)
filter_13 = StreamFilter(Gate=spindle_use_bollean_2, Stream1=join_6)
cut_exit_preview_line_2 = Curve(ln_6)
material_5 = CreateMaterial(
    Diffuse=ColourSwatch(SwatchColor=RGB(130, 249, 255)),
    Specular=RGB(255, 255, 255),
    Emission=RGB(0, 0, 0),
    Transparency=0,
    Shine=0)
material_6 = CreateMaterial(
    Diffuse=ColourSwatch(SwatchColor=RGB(99, 74, 16)),
    Specular=RGB(255, 255, 255),
    Emission=RGB(0, 0, 0),
    Transparency=0,
    Shine=0)
material_7 = CreateMaterial(
    Diffuse=ColourSwatch(SwatchColor=RGB(174, 234, 235)),
    Specular=RGB(255, 255, 255),
    Emission=RGB(0, 0, 0),
    Transparency=0,
    Shine=0)
material_8 = CreateMaterial(
    Diffuse=ColourSwatch(SwatchColor=RGB(77, 114, 115)),
    Specular=RGB(255, 255, 255),
    Emission=RGB(0, 0, 0),
    Transparency=0,
    Shine=0)
preview = CustomPreview(Geometry=toolpath_preview_line, Shader=material)
preview_2 = CustomPreview(Geometry=cut_transition_preview_line, Shader=material_2)
preview_3 = CustomPreview(Geometry=cut_entry_preview_line, Shader=material_3)
preview_4 = CustomPreview(Geometry=cut_exit_preview_line, Shader=material_4)
text_13 = Text("J2,")
preview_5 = CustomPreview(Geometry=toolpath_preview_line_2, Shader=material_5)
text_14 = Text(",")
preview_6 = CustomPreview(Geometry=cut_transition_preview_line_2, Shader=material_6)
preview_7 = CustomPreview(Geometry=cut_entry_preview_line_2, Shader=material_7)
preview_8 = CustomPreview(Geometry=cut_exit_preview_line_2, Shader=material_8)
text_15 = Text("J2,")
text_16 = Text(",")
join_11 = TextJoin(Text=[text_13, temp_home_x, text_14, temp_home_y])
join_12 = TextJoin(Text=[text_15, temp_home_x_2, text_16, temp_home_y_2])

# ---- group: Insert JZ commands
ma = MassAddition(Input=merge_3)  # -> Result, PartialResults
ins = InsertItems(List=flatten_5, Item=dup, Indices=ma.PartialResults, Wrap=True)

ma_2 = MassAddition(Input=merge_4)  # -> Result, PartialResults
ins_2 = InsertItems(List=flatten_6, Item=dup_5, Indices=ma_2.PartialResults, Wrap=True)

# ---- group: Jog to startpoints
item_13 = ListItem(List=pdecon_4.XComponent, Index=0, Wrap=True)
item_14 = ListItem(List=pdecon_4.YComponent, Index=0, Wrap=True)
lng_7 = ListLength(List=flatten(item_13))
text_17 = Text(",")
text_18 = Text("J2,")
dup_9 = DuplicateData(Data=text_18, Number=lng_7, Order=True)
dup_10 = DuplicateData(Data=text_17, Number=lng_7, Order=True)
simplify_13 = SimplifyTree(Tree=flatten(dup_9), Front=False)
simplify_14 = SimplifyTree(Tree=flatten(item_13), Front=False)
simplify_15 = SimplifyTree(Tree=flatten(dup_10), Front=False)
simplify_16 = SimplifyTree(Tree=flatten(item_14), Front=False)
graft_17 = GraftTree(Tree=simplify_13, IncludeEmptyLists=True, IncludeNullItems=True)
graft_18 = GraftTree(Tree=simplify_14, IncludeEmptyLists=True, IncludeNullItems=True)
graft_19 = GraftTree(Tree=simplify_15, IncludeEmptyLists=True, IncludeNullItems=True)
graft_20 = GraftTree(Tree=simplify_16, IncludeEmptyLists=True, IncludeNullItems=True)
join_13 = TextJoin(Text=[graft_17, graft_18, graft_19, graft_20])
jh = Text("JH")
flatten_7 = FlattenTree(Tree=join_13, Path="{0}")

# ----
filter_14 = StreamFilter(Gate=use_custom_jog_home_2, Stream0=jh, Stream1=flatten(join_11))

# ---- group: Jog to startpoints (continued)
merge_5 = Merge(Data1=flatten_7, Data2=filter_14)

# ---- group: Insert J2 commands
lng_8 = ListLength(List=merge_5)
dup_11 = DuplicateData(Data=Slider(1, range=0..1), Number=lng_8, Order=True)
addition_6 = Addition(A=dup_11, B=merge_3)
ma_3 = MassAddition(Input=addition_6)  # -> Result, PartialResults
ins_3 = InsertItems(List=ins, Item=merge_5, Indices=ma_3.PartialResults, Wrap=True)

# ----
flatten_8 = FlattenTree(Tree=ins_3, Path="{0}")
merge_6 = Merge(Data1=panel_23, Data3=filter_12, Data4=filter_7, Data5=filter_8, Data6=join_8, Data7=flatten_8, Data8=filter_6)
panel_25 = Panel(merge_6)
lng_9 = ListLength(List=panel_25)
panel_26 = Panel(lng_9)

# ---- group: Jog to startpoints
item_15 = ListItem(List=pdecon_5.XComponent, Index=0, Wrap=True)
item_16 = ListItem(List=pdecon_5.YComponent, Index=0, Wrap=True)
lng_10 = ListLength(List=flatten(item_15))
text_19 = Text(",")
text_20 = Text("J2,")
dup_12 = DuplicateData(Data=text_20, Number=lng_10, Order=True)
dup_13 = DuplicateData(Data=text_19, Number=lng_10, Order=True)
simplify_17 = SimplifyTree(Tree=flatten(dup_12), Front=False)
simplify_18 = SimplifyTree(Tree=flatten(item_15), Front=False)
simplify_19 = SimplifyTree(Tree=flatten(dup_13), Front=False)
simplify_20 = SimplifyTree(Tree=flatten(item_16), Front=False)
graft_21 = GraftTree(Tree=simplify_17, IncludeEmptyLists=True, IncludeNullItems=True)
graft_22 = GraftTree(Tree=simplify_18, IncludeEmptyLists=True, IncludeNullItems=True)
graft_23 = GraftTree(Tree=simplify_19, IncludeEmptyLists=True, IncludeNullItems=True)
graft_24 = GraftTree(Tree=simplify_20, IncludeEmptyLists=True, IncludeNullItems=True)
join_14 = TextJoin(Text=[graft_21, graft_22, graft_23, graft_24])
jh_2 = Text("JH")
flatten_9 = FlattenTree(Tree=join_14, Path="{0}")

# ----
filter_15 = StreamFilter(Gate=use_custom_jog_home_3, Stream0=jh_2, Stream1=flatten(join_12))

# ---- group: Jog to startpoints (continued)
merge_7 = Merge(Data1=flatten_9, Data2=filter_15)

# ---- group: Insert J2 commands
lng_11 = ListLength(List=merge_7)
dup_14 = DuplicateData(Data=Slider(1, range=0..1), Number=lng_11, Order=True)
addition_7 = Addition(A=dup_14, B=merge_4)
ma_4 = MassAddition(Input=addition_7)  # -> Result, PartialResults
ins_4 = InsertItems(List=ins_2, Item=merge_7, Indices=ma_4.PartialResults, Wrap=True)

# ----
flatten_10 = FlattenTree(Tree=ins_4, Path="{0}")
merge_8 = Merge(Data1=panel_24, Data3=filter_13, Data4=filter_10, Data5=filter_11, Data6=join_10, Data7=flatten_10, Data8=filter_9)
panel_27 = Panel(merge_8)
lng_12 = ListLength(List=panel_27)
panel_28 = Panel(lng_12)

# ==== cluster DivideCurveEvenLenght: Calculates approximate curve length for even division
crv = ClusterInput()
crv_2 = Curve(crv)
B = ClusterInput()
len = Length(Curve=crv_2)
division = Division(A=len, B=B)
int = Integer(division)
divide = DivideCurve(Curve=crv_2, Count=int, Kinks=False)  # -> Points, Tangents, Parameters
P = ClusterOutput(divide.Points)
